# Grasshopper definition gHowl_GPS_importData.ghx (Grasshopper 0.8.10)

# ---- group: Path to data
# Here you reference the CPH_data.csv file
path = FilePath("C:\Users\luis\Documents\gHowl Development\Example FIles\gHowlGPS\all2.csv")

# ----
file = ReadFile(Path=path, Lines=True)
vizmax = Slider(300, range=0..300)

# ---- group: Value to Plot
list = ValueList({"Temperature": 0, "Light": 1, "CO2": 2}, selected=[], Cyclical=False, ListIndex=2)

# ----
split = StringSplit(String=file, Separators=",")
rep = ReplaceString(String=split, Find="\"")

# ---- group: GPS
item = ListItem(List=rep, Index=5, Wrap=False)
# GPS Import Data
# This definition imports data captured by an ASKit device and parses the GPS and sensor data.
# 
# Note: This data was captured in Copenhagen, Denmark during the Smart Geometry Conference 2011 as part of the work by the Urban Feeds Cluster.
# 
# REQUIREMENTS:
# rhino file: cph_file.3dm
# data file: CPH_data.csv
# 
# ==================================================
# gHowl is a set of components which extend Grasshopper's ability to communicate and exchange information with other applications and physical devices.
# 
# Keep up with the latest developments of gHowl on the
# gHowl group on grasshopper3d.com:
# http://www.grasshopper3d.com/group/ghowl
# 
# gHowl is developed by:
# Damien Alomar: http://www.liquidtectonics.com
# Luis E. Fraguada: http://www.livearchitecture.net
# Giulio Piacentino: http://www.giuliopiacentino.com
item_2 = ListItem(List=rep, Index=3, Wrap=False)
pt = PointXYZ(XComponent=flatten(item), YComponent=flatten(item_2), ZComponent=0)

# ---- group: Light
item_3 = ListItem(List=rep, Index=16, Wrap=False)
num = Number(item_3)
bnd = Bounds(Numbers=flatten(num))
remap = RemapNumbers(Values=num, Source=bnd, Target=vizmax)

# ---- group: co2
item_4 = ListItem(List=rep, Index=18, Wrap=False)
num_2 = Number(item_4)
bnd_2 = Bounds(Numbers=flatten(num_2))
remap_2 = RemapNumbers(Values=num_2, Source=bnd_2, Target=vizmax)

# ---- group: Temp
item_5 = ListItem(List=rep, Index=14, Wrap=False)
num_3 = Number(item_5)
bnd_3 = Bounds(Numbers=flatten(num_3))
remap_3 = RemapNumbers(Values=num_3, Source=bnd_3, Target=vizmax)

# ----
refpt2_gps = Panel("{12.605615,55.683504, 0}")
refpt1_gps = Panel("{12.575636, 55.675648, 0}")
dms_dd = FormatGPS(GPS=graft(pt))
item_6 = ListItem(List=[remap_3, remap, remap_2], Index=list, Wrap=False)
refpt1_x_y_z = Point(<point referenced from the Rhino model>)
refpt2_x_y_z = Point(<point referenced from the Rhino model>)
Z = UnitZ(Factor=item_6)
gps_xyz = GPSToXYZ(
    GPS_IN=dms_dd,
    Pt1ReferenceXYZ=refpt1_x_y_z,
    Pt2ReferenceXYZ=refpt2_x_y_z,
    Pt1ReferenceGPS=refpt1_gps,
    Pt2ReferenceGPS=refpt2_gps)
move = Move(Geometry=gps_xyz, Translation=Z)  # -> Geometry, Transform
del = DelaunayMesh(Points=flatten(move.Geometry), Plane=PlaneXY(0, 0, 0))
bbox = BoundingBox(Content=del, Union=False, Plane=PlaneXY(0, 0, 0))  # -> Box, Box_2
explode = BrepComponents(Brep=bbox.Box)  # -> Faces, Edges, Vertices
slider = Slider(100, range=0..100)
item_7 = ListItem(List=explode.Faces, Index=4, Wrap=False)
sdivide = DivideSurface(Surface=item_7, UCount=slider, VCount=slider)  # -> Points, Normals, Parameters
Z_2 = UnitZ(Factor=1)
meshray = MeshRay(Mesh=del, Point=flatten(sdivide.Points), Direction=Z_2)  # -> Point, Hit
clean = CleanTree(Data=meshray.Point, CleanInvalid=True, CleanEmpty=True)
del_2 = DelaunayMesh(Points=clean, Plane=PlaneXY(0, 0, 0))
mcomp = Decompose(Mesh=del_2)  # -> Vertices, Faces, Colours, Normals
pcomp = Decompose(Point=mcomp.Vertices)  # -> XComponent, YComponent, ZComponent
bnd_4 = Bounds(Numbers=pcomp.ZComponent)
domcomp = DomainComponents(Domain=bnd_4)  # -> Start, End
gradient = Gradient(
    LowerLimit=domcomp.Start,
    UpperLimit=domcomp.End,
    Parameter=pcomp.ZComponent,
    stops=[0: None, 0: None, 0: None, 0: None, 0: None])
mcol = MeshColours(Mesh=del_2, Colours=gradient)
wires = BrepWireframe(Brep=bbox.Box, Density=-1)
item_8 = ListItem(List=wires, Index=10, Wrap=False)
divide = DivideCurve(Curve=item_8, Number=30, Kinks=False)  # -> Points, Tangents, Parameters
xy = XYPlane(Origin=divide.Points)
sec = MeshPlane(Mesh=mcol, Plane=xy)
