# Grasshopper definition gHowl_GEO_xyz-geo.ghx (Grasshopper 0.8.10)

crv = Curve([<curve referenced from the Rhino model> x3])
refpt1_gps = Panel("{12.575636, 55.675648, 0}")
divide = DivideCurve(Curve=crv, Number=20, Kinks=False)  # -> Points, Tangents, Parameters
refpt1_x_y_z = Point(<point referenced from the Rhino model>)
xyz_gps = XYZToGPS(XYZ_IN=divide.Points, EAP_XYZ=refpt1_x_y_z, EAP_GPS=refpt1_gps)
# XYZ -> GPS
# This definition converts from XYZ coordinates to Longitude, Latitude, Altitude.
# 
# REQUIREMENTS:
# rhino file: cph_file.3dm
# 
# ==================================================
# gHowl is a set of components which extend Grasshopper's ability to communicate and exchange information with other applications and physical devices.
# 
# Keep up with the latest developments of gHowl on the
# gHowl group on grasshopper3d.com:
# http://www.grasshopper3d.com/group/ghowl
# 
# gHowl is developed by:
# Damien Alomar: http://www.liquidtectonics.com
# Luis E. Fraguada: http://www.livearchitecture.net
# Giulio Piacentino: http://www.giuliopiacentino.com
longitude_latitude_altitude = Panel(xyz_gps)
