# Grasshopper definition gHowl_OSC_dispatch.ghx (Grasshopper 0.8.1)

# ---- group: Receive
send_pattern_osc = Panel("999")
port = Panel("1000")
netsource = NetworkSource()  # -> NetworkAdapterIsUp, AdapterProperties, LocalIpAddress
osc_addresses = Panel("""/1/fader1
/1/fader2
/1/fader3
/1/fader4
/1/fader5
/3/xy""")
udp = UDPReceiver(Address=netsource.LocalIpAddress, Port=port, Pattern=send_pattern_osc)  # -> Info, Data
# OSC Dispatch / Channel
# 
# This definition tests the receiving of OSC messages.  The definition is set up to communicate with an iPod Touch running TouchOSC, 'Simple' Layout.  Alternatively, one could set it up with the app MRMR which is free of cost.
# 
# REQUIREMENTS:
# TouchOSC iPod App
# 
# ==================================================
# gHowl is a set of components which extend Grasshopper's ability to communicate and exchange information with other applications and physical devices.
# 
# Keep up with the latest developments of gHowl on the
# gHowl group on grasshopper3d.com:
# http://www.grasshopper3d.com/group/ghowl
# 
# gHowl is developed by:
# Damien Alomar: http://www.liquidtectonics.com
# Luis E. Fraguada: http://www.livearchitecture.net
# Giulio Piacentino: http://www.giuliopiacentino.com
message = Panel([udp.Info, udp.Data])
_1_fader1 = OSCChannel(OSCMessage=udp.Data)
osc_d = OSCDispatch(OSCDevices=osc_addresses, OSCMessage=udp.Data)  # -> OSCDevice, OSCData
osc_data = Panel(_1_fader1)
osc_data_2 = Panel(osc_d.OSCData)
