# Grasshopper definition SpreadsheetOut.gh (Grasshopper 0.8.50)

path_to_file_you_want_to_create = Panel("C:\Data\pointsOut.xlsx")
sphcloud = SphericalCloud(Center=Point(0, 0, 0), Radius=10, Number=20)  # -> graft(Cloud), Normals
trigrid = Triangular(Plane=PlaneXY(0, 0, 0), Size=1, ExtentX=5, ExtentY=5)  # -> Cells, flatten(Points)
radgrid = Radial(Plane=PlaneXY(0, 0, 0), Size=1, ExtentR=5, ExtentP=20)  # -> Cells, flatten(Points)
pcomp = Decompose(Point=graft(trigrid.Points))  # -> XComponent, YComponent, ZComponent
pcomp_2 = Decompose(Point=graft(radgrid.Points))  # -> XComponent, YComponent, ZComponent
pcomp_3 = Decompose(Point=sphcloud.Cloud)  # -> XComponent, YComponent, ZComponent
data = Data(simplify([pcomp.XComponent, pcomp.YComponent, pcomp.ZComponent]))
data_2 = Data(simplify([pcomp_2.XComponent, pcomp_2.YComponent, pcomp_2.ZComponent]))
data_3 = Data(simplify([pcomp_3.XComponent, pcomp_3.YComponent, pcomp_3.ZComponent]))
# Spreadsheet Out
# 
# This definition exports data from Grasshopper to an .xlsx file.
# 
# REQUIREMENTS:
# Install OpenXMLSDKv2.msi
# Set up the path to the spreadsheet you want to create.
# 
# USAGE:
# Each is branch is a row, each item in the branch will go into a column.  To add another worksheet to the spreadsheet, right-click the component and go to the Input Manager.  The name of the input will be the name of the worksheet.
# 
# ==================================================
# gHowl is a set of components which extend Grasshopper's ability to communicate and exchange information with other applications and physical devices.
# 
# Keep up with the latest developments of gHowl on the
# gHowl group on grasshopper3d.com:
# http://www.grasshopper3d.com/group/ghowl
# 
# gHowl is developed by:
# Damien Alomar: http://www.liquidtectonics.com
# Luis E. Fraguada: http://www.livearchitecture.net
# Giulio Piacentino: http://www.giuliopiacentino.com
spreadsheet_writer = SpreadsheetWriter(Path=path_to_file_you_want_to_create, Stream1=data_3, Stream2=data, Stream3=data_2)
