# Grasshopper definition gHowl_UDP_send+receive.ghx (Grasshopper 0.8.1)

# ---- group: Receive
port = Panel("7001")
udp_owl = UDPReceiver(Port=port, Pattern=0)  # -> Info, Data
panel = Panel(udp_owl.Info)
panel_2 = Panel(udp_owl.Data)

# ---- group: Send / Attractor Position
md_slider = MDSlider(
    slider_value=Point(0.3388999167, 0.3837278814, 0.5),
    x_domain=Domain(0, 200),
    y_domain=Domain(0, 200),
    z_domain=Domain(0, 1))

# ---- group: Receive / Parse UDP Message
split = StringSplit(String=udp_owl.Data, Separators=";")
concat = Concatenate(Start="{", End=split)
concat_2 = Concatenate(Start=concat, End=",0}")

# ---- group: Send
pcomp = Decompose(Point=md_slider)  # -> XComponent, YComponent, ZComponent
sph = Sphere(Base=md_slider, Radius=20)
concat_3 = Concatenate(Start=pcomp.XComponent, End=",")
concat_4 = Concatenate(Start=concat_3, End=pcomp.YComponent)
panel_3 = Panel(concat_4)
# UDP Agents Seek
# 
# This definition tests the sending and receiving of UDP messages from an associated Processing sketch: See_Arrive.pde
# (Adapted from Daniel Shiffman's example <http://www.shiffman.net>)
# 
# REQUIREMENTS:
# Processing: http://processing.org
# UDP Library by Stephane Cousot:
# http://ubaa.net/shared/processing/udp/
# 
# ==================================================
# gHowl is a set of components which extend Grasshopper's ability to communicate and exchange information with other applications and physical devices.
# 
# Keep up with the latest developments of gHowl on the
# gHowl group on grasshopper3d.com:
# http://www.grasshopper3d.com/group/ghowl
# 
# gHowl is developed by:
# Damien Alomar: http://www.liquidtectonics.com
# Luis E. Fraguada: http://www.livearchitecture.net
# Giulio Piacentino: http://www.giuliopiacentino.com
port_2 = Panel("7000")
udp_owl_2 = UDPSender(Port=port_2, Pattern=0, Data=panel_3)

# ---- group: Receive / Agents
pt = Point(concat_2)
