# Grasshopper definition gHowl_receive_mouse2d.ghx (Grasshopper 0.8.1)

# ---- group: Receive
port_to_listen_to = Panel("9000")
receive_pattern = Panel("0")
udp_owl = UDPReceiver(Port=port_to_listen_to, Pattern=receive_pattern)  # -> Info, Data
split = StringSplit(String=udp_owl.Data, Separators=";")
# UDP Mouse 2D Sender
# 
# This definition tests the receiving of UDP messages from an associated Processing sketch: Mouse2D_sender.pde
# 
# REQUIREMENTS:
# Processing: http://processing.org
# UDP Library by Stephane Cousot:
# http://ubaa.net/shared/processing/udp/
# 
# ==================================================
# gHowl is a set of components which extend Grasshopper's ability to communicate and exchange information with other applications and physical devices.
# 
# Keep up with the latest developments of gHowl on the
# gHowl group on grasshopper3d.com:
# http://www.grasshopper3d.com/group/ghowl
# 
# gHowl is developed by:
# Damien Alomar: http://www.liquidtectonics.com
# Luis E. Fraguada: http://www.livearchitecture.net
# Giulio Piacentino: http://www.giuliopiacentino.com
panel = Panel([udp_owl.Info, udp_owl.Data])
item = ListItem(List=split, Index=0, Wrap=False)
item_2 = ListItem(List=split, Index=1, Wrap=False)
pt = PointXYZ(XComponent=item, YComponent=item_2, ZComponent=0)
