# Grasshopper definition gHowl_sendUDP.ghx (Grasshopper 0.8.1)

sending_pattern = Panel("0")
port_to_send_to = Panel("10000")
netsource = NetworkSource()  # -> NetworkAdapterIsUp, AdapterProperties, LocalIpAddress
panel = Panel(Slider(46.25, range=0..100))
# UDP Send Value
# 
# This definition tests the sending of UDP messages from an associated Processing sketch: gHowl_udpSend.pde
# 
# REQUIREMENTS:
# Processing: http://processing.org
# UDP Library by Stephane Cousot:
# http://ubaa.net/shared/processing/udp/
# 
# ==================================================
# gHowl is a set of components which extend Grasshopper's ability to communicate and exchange information with other applications and physical devices.
# 
# Keep up with the latest developments of gHowl on the
# gHowl group on grasshopper3d.com:
# http://www.grasshopper3d.com/group/ghowl
# 
# gHowl is developed by:
# Damien Alomar: http://www.liquidtectonics.com
# Luis E. Fraguada: http://www.livearchitecture.net
# Giulio Piacentino: http://www.giuliopiacentino.com
udp_owl = UDPSender(Port=port_to_send_to, Pattern=sending_pattern, Data=panel)
