# Grasshopper definition ghowl_UDP_receive_springs.ghx (Grasshopper 0.8.1)

port = Panel("6406")
udp_owl = UDPReceiver(Port=port, Pattern=0)  # -> Info, Data
panel = Panel(udp_owl.Info)

# ---- group: Parse UDP Message
split = StringSplit(String=udp_owl.Data, Separators=";")
# UDP Receive Springs
# 
# This definition tests the receiving of UDP messages from an associated Processing sketch: cloth_ed.pde.
# 
# REQUIREMENTS:
# Processing: http://processing.org
# UDP Library by Stephane Cousot:
# http://ubaa.net/shared/processing/udp/
# TRAER Physics Library byJeffrey Traer Bernstein:
# http://www.cs.princeton.edu/~traer/physics/
# 
# 
# ==================================================
# gHowl is a set of components which extend Grasshopper's ability to communicate and exchange information with other applications and physical devices.
# 
# Keep up with the latest developments of gHowl on the
# gHowl group on grasshopper3d.com:
# http://www.grasshopper3d.com/group/ghowl
# 
# gHowl is developed by:
# Damien Alomar: http://www.liquidtectonics.com
# Luis E. Fraguada: http://www.livearchitecture.net
# Giulio Piacentino: http://www.giuliopiacentino.com
concat = Concatenate(Start="{", End=split)
concat_2 = Concatenate(Start=concat, End=",0}")
shift = ShiftList(List=concat_2, Shift=-1, Wrap=False)

# ----
pt = Point(shift)
