# Grasshopper definition gHowl_UDP_receive_Cam.ghx (Grasshopper 0.8.1)

udp_owl = UDPReceiver(Port="6400", Pattern=0)  # -> Info, Data
panel = Panel(udp_owl.Info)
split = StringSplit(String=udp_owl.Data, Separators=";")
split_2 = StringSplit(String=split, Separators=",")
# UDP Webcam
# 
# This definition tests the receiving of UDP messages from an associated Processing sketch: gHowl_UDP_receive_CAM.pde
# 
# 
# REQUIREMENTS:
# Processing: http://processing.org
# UDP Library by Stephane Cousot:
# http://ubaa.net/shared/processing/udp/
# JMYron Library:
# http://webcamxtra.sourceforge.net/
# 
# ==================================================
# gHowl is a set of components which extend Grasshopper's ability to communicate and exchange information with other applications and physical devices.
# 
# Keep up with the latest developments of gHowl on the
# gHowl group on grasshopper3d.com:
# http://www.grasshopper3d.com/group/ghowl
# 
# gHowl is developed by:
# Damien Alomar: http://www.liquidtectonics.com
# Luis E. Fraguada: http://www.livearchitecture.net
# Giulio Piacentino: http://www.giuliopiacentino.com
viewer = ParamViewer(split_2)
shift = ShiftList(List=viewer, Shift=-1, Wrap=False)
branch = TreeBranch(Tree=split_2, Path=shift)
item = ListItem(List=branch, Index=2, Wrap=False)
item_2 = ListItem(List=branch, Index=1, Wrap=False)
item_3 = ListItem(List=branch, Index=0, Wrap=False)
rgb = ColourRGB(Alpha=255, Red=item_3, Green=item_2, Blue=item)
col = Colour(flatten(rgb))
path_mapper = PathMapper(col, source="{A}(i)", target="{Floor(i/ceiling(item_count/40))}")  # disabled
series = Series(Start=0, Step=1, Count=40)
series_2 = Series(Start=0, Step=1, Count=40)
viewer_2 = ParamViewer(path_mapper)  # disabled
pt = PointXYZ(XComponent=series, YComponent=series_2, ZComponent=0, DataComparison="cross_reference")
preview = CustomPreview(Geometry=pt, Shader=col)
