# Grasshopper definition gHowl_receive_mouse2d.ghx (Grasshopper 0.7.30)

port_to_listen_to = Panel("9000")
receive_pattern = Panel("0")
netsource = NetworkSource()  # -> N, S, port
udp_owl = UDPOwlReceiver(port=netsource.port, P=port_to_listen_to, port_2=receive_pattern)  # -> I, D
split = StringSplit(S=udp_owl.D, c=";")
panel = Panel([udp_owl.I, udp_owl.D])
item = ListItem(L=split, i=0, W=False)
item_2 = ListItem(L=split, i=1, W=False)
pt = PointXYZ(X=item, Y=item_2, Z=0)
