# Grasshopper definition gHowl_sendUDP.ghx (Grasshopper 0.7.30)

sending_pattern = Panel("0")
port_to_send_to = Panel("10000")
netsource = NetworkSource()  # -> N, S, port
panel = Panel(Slider(0.2125, range=0..1))
udp_owl = UDPOwlSender(port=netsource.port, P=port_to_send_to, port_2=sending_pattern, D=panel)
