# Grasshopper definition 01_Test_ Controlando un atractor desde VVVV.ghx (Grasshopper 0.8.50)

image = ImageSampler(
    FilePath="C:\Users\Juanma\Documents\Fotos\6051_107580390669_661575669_2663526_1775203_n.jpg",
    RelativeFilePath="..\..\Documents\Fotos\6051_107580390669_661575669_2663526_1775203_n.jpg",
    Interpolate=False,
    Wrap=1,
    Umin=0,
    Umax=1,
    Vmin=0,
    Vmax=1,
    Filter="Colour")
udp = UDPReceiver(Port=3333, Pattern=0)  # -> Info, Data
panel = Panel(udp.Info)
panel_2 = Panel(udp.Data)
split = StringSplit(String=panel_2, Separators=",")
item = ListItem(List=split, Index=0, Wrap=False)
item_2 = ListItem(List=split, Index=1, Wrap=False)
panel_3 = Panel(item)
panel_4 = Panel(item_2)

# ----
# Creamos un punto y lo asignamos como Punto Atractor.
# Usamos sus coordenadas para dibujar un círculo y extraer las coordenadas de su centro.
# Esta operación es sólo para visualizar bien la posición del Punto Atractor.
pt = PointXYZ(XComponent=panel_3, YComponent=panel_4, ZComponent=0)
radio_círculo = Slider(1.73, range=1..10)
cir = Circle(Plane=pt, Radius=radio_círculo)
cen = Center(Arc=cir)  # -> Center, Radius

# ----
# Creamos una Rejilla Cuadrada, que controlaremos con un slider para NÚMERO de celdillas en X y en Y, y otro para controlar el TAMAÑO de las celdillas.
celdillas_en_x_y_en_y = Slider(14, range=1..50)
tamaño_celdillas = Slider(4, range=1..10)
sqgrid = Square(Plane=PlaneXY(0, 0, 0), Size=tamaño_celdillas, ExtentX=celdillas_en_x_y_en_y, ExtentY=celdillas_en_x_y_en_y)  # -> Cells, Points

# ----
# Calculamos la DISTANCIA entre el Punto Atractor y los Puntos que configuran la Rejilla Cuadrada
dist = Distance(PointA=cen.Center, PointB=sqgrid.Points)

# ----
# Dividimos la Distancia ya calculada, por un parámetro, que será la Fuerza Atractora de nuestro punto.
# Cuanto mayor sea este parámetro, más pequeño será el radio de nuestros polígonos (que veremos en el paso siguiente)
fuerza_atractora = Slider(12, range=1..50)
division = Division(A=dist, B=fuerza_atractora)

# ----
# Dividimos el Tamaño de las celdillas por 2, para que los polígonos no se superpongan nunca.
f_x = F1(Function="x/2", X=tamaño_celdillas)

Z = UnitZ(Factor=dist)

# ----
# Calculamos qué valor es más PEQUEÑO:
# Vemos si la Distancia, ya calculada, es MENOR que el Tamaño de la Rejilla cuadrada minorada, para que los polígonos no se superpongan nunca.
min = Minimum(A=division, B=f_x)

cir_2 = Circle(Plane=sqgrid.Points, Radius=min)
extr = Extrude(Base=cir_2, Direction=Z)
