# Grasshopper definition 02_Test_Color pixeles loop para crear una superficie.ghx (Grasshopper 0.8.51)

puerto_a_la_escucha = Panel("6666")
udp_owl = UDPReceiver(Port=puerto_a_la_escucha, Pattern=0)  # -> Info, Data
panel = Panel(udp_owl.Data)
panel_2 = Panel(udp_owl.Info)
split = StringSplit(String=udp_owl.Data, Separators=";")
split_2 = StringSplit(String=split, Separators=",")
viewer = ParamViewer(split_2)
shift = ShiftList(List=viewer, Shift=-1, Wrap=False)
branch = TreeBranch(Tree=split_2, Path=shift)
item = ListItem(List=branch, Index=0, Wrap=False)
item_2 = ListItem(List=branch, Index=1, Wrap=False)
item_3 = ListItem(List=branch, Index=2, Wrap=False)
remap = RemapNumbers(Values=item, Source=Domain(0, 1), Target=Domain(0, 50))
hsl = ColourHSL(Alpha=1, Hue=item, Saturation=item_2, Luminance=item_3)
Z = UnitZ(Factor=flatten(remap))
col = Colour(flatten(hsl))
series = Series(Start=0, Step=1, Count=50)
series_2 = Series(Start=0, Step=1, Count=50)
panel_3 = Panel(item_2)
rev = ReverseList(List=series)
pt = PointXYZ(XComponent=rev, YComponent=series_2, ZComponent=0, DataComparison="cross_reference")
preview = CustomPreview(Geometry=pt, Shader=col)
move = Move(Geometry=pt, Translation=Z)  # -> Geometry, Transform; disabled
srfgrid = SurfaceFromPoints(Points=move.Geometry, UCount=10, Interpolate=False)  # disabled
