# Grasshopper definition 03_Test_Superficie Acústica.ghx (Grasshopper 0.8.51)

image = ImageSampler(
    FilePath="C:\Users\Luis E. Fraguada\Desktop\gHowl\vvvv\Documents\Fotos\6051_107580390669_661575669_2663526_1775203_n.jpg",
    RelativeFilePath="..\..\..\Documents\Fotos\6051_107580390669_661575669_2663526_1775203_n.jpg",
    Interpolate=False,
    Wrap=1,
    Umin=0,
    Umax=1,
    Vmin=0,
    Vmax=1,
    Filter="Colour")
# AMPLIFYING VALUES
amplification_factor = Slider(37, range=1..100)

origin_of_the_domain = Slider(0, range=0..1)
# OPERATIONS WITH DOMAIN' POINTS
number_of_steps = Slider(64, range=1..200)
end_of_the_domain = Slider(117, range=1..400)
dom = Domain(DomainStart=origin_of_the_domain, DomainEnd=end_of_the_domain)
range = Range(Domain=dom, Steps=number_of_steps)

pattern = Panel("0")
port_connected = Panel("4444")

udp = UDPReceiver(Port=port_connected, Pattern=pattern)  # -> Info, Data

# ----
# Random[Arq]
string_values = Panel(udp.Data)
# UDP CONNECTION
communication_information = Panel(udp.Info)

separator_character = Panel(";")
# OPERATIONS WITH STRING
split = StringSplit(String=string_values, Separators=separator_character)
split_string_in_pairs = Panel(split)
separator_character_2 = Panel(",")
split_2 = StringSplit(String=split_string_in_pairs, Separators=separator_character_2)
spliting_string_pairs_of_values = Panel(split_2)

path_mapper = PathMapper(split_2, source="{A;B;C;D}(i)", target="(i)")
# OPERATIONS WITH LEFT CHANNELS' VALUES
values_left_channel = Panel(path_mapper)
multiplication = Multiplication(A=values_left_channel, B=amplification_factor)
amplified_values = Panel(multiplication)
pt = PointXYZ(XComponent=0, YComponent=range, ZComponent=amplified_values)
crv = Curve(Vertices=pt, Degree=3, Periodic=False)  # -> Curve, Length, Domain

branch_target = Panel("(-1)")
path_mapper_2 = PathMapper(split_2, source="{A;B;C;D}(i)", target="(-i)")
branch = TreeBranch(Tree=path_mapper_2, Path=branch_target)
values_right_channel = Panel(branch)
# OPERATIONS WITH RIGHT CHANNELS' VALUES
flatten = FlattenTree(Data=values_right_channel, Path="{0}")
values_right_channel_2 = Panel(flatten)
multiplication_2 = Multiplication(A=values_right_channel_2, B=amplification_factor)
offset_from_axis_x = Slider(32, range=0..100)
amplified_values_2 = Panel(multiplication_2)
pt_2 = PointXYZ(XComponent=offset_from_axis_x, YComponent=range, ZComponent=amplified_values_2)
crv_2 = Curve(Vertices=pt_2, Degree=3, Periodic=False)  # -> Curve, Length, Domain

# ----
# LOFTED SURFACE
loft = Loft(
    Section=[crv.Curve, crv_2.Curve],
    Options={Adjust=False, Closed=False, Rebuild=10, Refit=0.01, LoftType=0, LoftEnds=0, LoftSimp=0})
