# Grasshopper definition XmlWriter_Basic.ghx (Grasshopper 0.8.10)

# XML Writer Basic Example
cat = Catenary(
    PointA=Point(-1.775551955, 7.653893971, 16.32826421),
    PointB=Point(31.79737191, 15.46360551, 14.06882401),
    Length=46,
    Gravity=Vector(0, 0, -1))
# Create some data...
pframes = PerpFrames(Curve=cat, Number=12, Align=True)  # -> Frames, Parameters
cir = Circle(Plane=pframes.Frames, Radius=2.5)
divide = DivideCurve(Curve=cir, Number=12, Kinks=False)  # -> Points, Tangents, Parameters
# 3b. Resolve Lists - Path Mapper
# A path mapper is a tool that can also be
# useful in remapping lists to individual nodes.
# Note the XML structure is the same as 3a.
path_mapper = PathMapper(divide.Points, source="{a;b;c}(i)", target="{a;b;c;i}")
# 3a. Resolve Lists - Gaft
# Since an XML element can only contain
# one piece of data, any path that has a list
# of data should be broken down so that
# each element in the list has its own node.
# This is most easily done through the Gaft
# component.  The original node with the list
# of data becomes the parent to a series of
# child nodes representing the individual
# data elements.
graft = GraftTree(Data=divide.Points, Strip=False)
# 1. Add Data
# 2. Label Elements
panel = Panel("Point")
xml = WriteXML(Data=graft)
# Element names can be supplied if you
# have them.  Here the path mapper is used
# in conjunction with some duplicated strings
# to map the names to the correct paths. Any
# path that does not have a name supplied will
# use its default name generated from the path.
dup = DuplicateData(Data=panel, Number=13, Order=True)
# Only Data is needed to create an
# XML string.  Each piece of data will
# be turned into a string. By default the
# path will be used to create the
# element name.  Notice that the
# component is orange, indicating a
# warning. This is because the XML
# Writer cannot output multiple pieces
# of data per path.  See example 3
# for a work around.
xml_2 = WriteXML(Data=divide.Points)
xml_3 = WriteXML(Data=path_mapper)
path_mapper_2 = PathMapper(dup, source="{a;b}(i)", target="{a;b;i}(0)")
panel_2 = Panel(xml)
panel_3 = Panel(xml_3)
panel_4 = Panel(xml_2)
xml_4 = WriteXML(Data=divide.Points, ElementNames=path_mapper_2)
panel_5 = Panel(xml_4)
