# Grasshopper definition gHowl_UpdatePachube.gh (Grasshopper 0.8.50)

pachube_api_key = Panel("Your API Key")
# Pachube URL: http://api.pachube.com/v2/feeds/12345.csv
pachube_url = Panel("http://api.pachube.com/v2/feeds/12345.xml")
# Pachube Update
# 
# This definition tests the updating of pachube data from grasshopper to the web
# 
# REQUIREMENTS:
# Internet Connection
# Pachube API key
# Pachube Feed Url (with suffix .xml or .csv)
# 
# USAGE:
# After the API key and URL, you must provide data to one of the numeric inputs.  Each input nickname corresponds to the 'ID' of your pachube Feed datastream.  The input names do not have to be sequential.  To add more inputs, simply right-click and go to the input manager.
# 
# ==================================================
# gHowl is a set of components which extend Grasshopper's ability to communicate and exchange information with other applications and physical devices.
# 
# Keep up with the latest developments of gHowl on the
# gHowl group on grasshopper3d.com:
# http://www.grasshopper3d.com/group/ghowl
# 
# gHowl is developed by:
# Damien Alomar: http://www.liquidtectonics.com
# Luis E. Fraguada: http://www.livearchitecture.net
# Giulio Piacentino: http://www.giuliopiacentino.com
update_pachube = PachubeUpdate(
    APIKey=pachube_api_key,
    Url=pachube_url,
    Datastream0=Slider(0.688, range=0..1),
    Datastream1=Slider(0.201, range=0..1),
    Datastream2=Slider(0.676, range=0..1))
